# Dynamo graph elevacionColumNum_script.dyn (Dynamo 2.3.1.11775)
# packages: Clockwork for Dynamo 2.x 2.4.0, Orchid 200.4.0.7938, Data-Shapes 2021.2.94, Crumple 2022.2.13, BIM4Struc.Productivity 2.2.2, Genius Loci 2020.8.3, archi-lab.net 2022.210.2419

code_block = CodeBlock { "Elevación Columna Numerada"; }
code_block_2 = CodeBlock()
# ---------- code_block_2.designscript (10 lines) ----------
//buttonText
"INICIAR";
//buttonCancel
"CANCELAR";
//maxHeight

//width
440;
//label
180;
# ----------------------------------------
code_block_3 = CodeBlock { "Seleccionar una Columna Numerada:"; }
code_block_4 = CodeBlock { "SELECCIONAR"; }
code_block_5 = CodeBlock { "Structural Columns"; }
byName = Category.ByName(name=code_block_5)
selectmodelelements_data_ordered = Custom[SelectModelElements Data (ordered)](InputName=code_block_3, ButtonText=code_block_4, CategoryFilter=byName)  # package Data-Shapes; Creates a Revit element selection input for UI.MultipleInputForm++ . Check out www.data-shapes.net for more infos!
code_block_6 = CodeBlock { "Orientación Seccion:"; }
code_block_7 = CodeBlock { ["Horizontal","Vertical"]; [0,1]; }
code_block_8 = CodeBlock { 0; }
radiobuttons_data = Custom[RadioButtons Data](InputName=code_block_6, Keys=code_block_7.out0, Values=code_block_7.out1, DefaultValueIndex=code_block_8)  # package Data-Shapes; Create radio buttons input for UI.MultipleInputForm ++ .
code_block_9 = CodeBlock { "Escala:"; }
code_block_10 = CodeBlock()
# ---------- code_block_10.designscript (6 lines) ----------
[
"1:50",
"1:75",
"1:100",
"1:125"
];
# ----------------------------------------
code_block_11 = CodeBlock { ":"; }
split = String.Split(str=code_block_10, separator0=code_block_11)
code_block_12 = CodeBlock { 1; }
getItemAtIndex = List.GetItemAtIndex(list=split@L2, index=code_block_12)
toNumber = String.ToNumber(str=getItemAtIndex)
code_block_13 = CodeBlock { 0; false; }
dropdown_data = Custom[DropDown Data](InputName=code_block_9, Keys=code_block_10, Values=toNumber, DefaultValueIndex=code_block_13.out0, Sorted_optional=code_block_13.out1)  # package Data-Shapes; Create data for DropDown input in UI.MultiInputForm ++ . Check out www.data-shapes.net for more infos.
list_create = List.Create(item0=selectmodelelements_data_ordered, item1=radiobuttons_data, item2=dropdown_data)
inputgroup_data = Custom[InputGroup Data](Inputs=list_create)  # package Data-Shapes; Creates a group of inputs for UI.MultipleInputForm ++ . Check out www.data-shapes.net for more infos !
boolean = BoolSelector(true)
multipleinputform = Custom[MultipleInputForm ++](Description_optional=code_block, ButtonText_optional=code_block_2.out0, Inputs=inputgroup_data, Toggle=boolean, CancelButtonText_optional=code_block_2.out1, Width_optional=code_block_2.out2, LabelWidth_optional=code_block_2.out3)  # package Data-Shapes; Create a form with multiple inputs. see www.data-shapes.net for tutorials and infos!
code_block_14 = CodeBlock(x=multipleinputform.User_Inputs)
# ---------- code_block_14.designscript (13 lines) ----------
x;

[Imperative]
{
	if(x == null)
	{
		return = [[],[],[]];
	}
	else
	{
		return = x;
	}
};
# ----------------------------------------
code_block_15 = CodeBlock(x=code_block_14.out1) { x[0]; }
code_block_16 = CodeBlock { "Numeracion Columna"; }
getParameterValueByName = Element.GetParameterValueByName(element=code_block_15, parameterName=code_block_16)
code_block_17 = CodeBlock { ""; }
eq = getParameterValueByName == code_block_17
anyTrue = Orchid.Common.List.AnyTrue(list=eq)
code_block_18 = CodeBlock(x=anyTrue, y=code_block_14.out1)
# ---------- code_block_18.designscript (14 lines) ----------
x;
y;

[Imperative]
{
	if(x == true)
	{
		return = null;
	}
	else
	{
		return = y;
	}
};
# ----------------------------------------
code_block_19 = CodeBlock(x=code_block_18.out2)  # same code as code_block_14
code_block_20 = CodeBlock(x=code_block_19.out1) { x[0]; }
code_block_21 = CodeBlock { "Column Style"; 1; }
setParameterByName = Element.SetParameterByName(element=code_block_20, parameterName=code_block_21.out0, value=code_block_21.out1)
geometry = Element.Geometry(element=setParameterByName)
flatten = List.Flatten(list=geometry)
location = Custom[Element.Location+](element=setParameterByName)  # package Clockwork for Dynamo 2.x; Returns the location of an element as point, curve or curve loop, along with some booleans to help filtering the results. Unlike the OOTB Element.GetLocation node, it also retunrs sketch lines of sketch-based elements like floor slabs as well as the element's rotation property.
code_block_22 = CodeBlock(x=location.curves)
# ---------- code_block_22.designscript (12 lines) ----------
x;
[Imperative]
{
	if(x == null)
	{
		return = [];
	}
	else
	{
		return = x;
	}
};
# ----------------------------------------
code_block_23 = CodeBlock { 0.5; }
pointAtParameter = Curve.PointAtParameter(curve=code_block_22.out1, param=code_block_23)
activeView = Orchid.RevitProject.Common.Document.ActiveView()
plane = Custom[View.Plane](view=activeView)  # package Clockwork for Dynamo 2.x; Retrieves the plane of a given view
normal = Plane.Normal(plane=plane)
byOriginNormal = Plane.ByOriginNormal(origin=pointAtParameter, normal=normal)
intersect = Geometry.Intersect(geometry=flatten, other=byOriginNormal)
await_ = Orchid.Common.DataStream.Await(pass=setParameterByName, waitFor=intersect)
code_block_24 = CodeBlock { "Column Style"; 0; }
setParameterByName_2 = Element.SetParameterByName(element=await_, parameterName=code_block_24.out0, value=code_block_24.out1)
code_block_25 = CodeBlock { "Error."; }
code_block_26 = CodeBlock(x=code_block_18.out2)
# ---------- code_block_26.designscript (12 lines) ----------
x;
[Imperative]
{
	if (x == null)
	{
		return = "La Columna seleccionada no tienen Numeración.\nLa Columna seleccionada debe haber sido numerada antes de ser elevada.";
	}
	else
	{
		return = [];
	}
};
# ----------------------------------------
uimessenger = Custom[© UIMessenger](title=code_block_25, body=code_block_26.out1)  # package Crumple; Displays a message box with a title/body and OK/cancel button. If OK is selected, the third input's data will be passed through.
all = Orchid.RevitProject.Views.View.All()
code_block_27 = CodeBlock { "Subclasificacion"; }
getParameterValueByName_2 = Element.GetParameterValueByName(element=all, parameterName=code_block_27)
code_block_28 = CodeBlock { "04_CH"; }
eq_2 = getParameterValueByName_2 == code_block_28
filterByBoolMask = List.FilterByBoolMask(list=all, mask=eq_2)
viewType = archilab.Revit.Views.Views.ViewType(view=filterByBoolMask.in)
code_block_29 = CodeBlock { "CeilingPlan"; }
eq_3 = viewType == code_block_29
filterByBoolMask_2 = List.FilterByBoolMask(list=filterByBoolMask.in, mask=eq_3)
code_block_30 = CodeBlock { "Structural Columns"; }
byName_2 = Category.ByName(name=code_block_30)
all_elements_of_category = ElementsOfCategory(Category=byName_2)
code_block_31 = CodeBlock { "Numeracion Columna"; }
exists = Orchid.RevitProject.Parameters.Parameter.Exists(parameterName=code_block_31, element=all_elements_of_category)
filterByBoolMask_3 = List.FilterByBoolMask(list=all_elements_of_category, mask=exists)
code_block_32 = CodeBlock { "Numeracion Columna"; }
getParameterValueByName_3 = Element.GetParameterValueByName(element=filterByBoolMask_3.in, parameterName=code_block_32)
code_block_33 = CodeBlock(x=code_block_19.out1) { x[0]; }
code_block_34 = CodeBlock { "Numeracion Columna"; }
getParameterValueByName_4 = Element.GetParameterValueByName(element=code_block_33, parameterName=code_block_34)
code_block_35 = CodeBlock { null; }
replaceEmptyLists = Custom[List.ReplaceEmptyLists](seq=getParameterValueByName_4, Replacement=code_block_35)  # package Clockwork for Dynamo 2.x; Replaces all empty lists within a given list with a substitute
eq_4 = getParameterValueByName_3@L1 == replaceEmptyLists@L2  # lacing=Longest
anyTrue_2 = Orchid.Common.List.AnyTrue(list=eq_4@L2)
filterByBoolMask_4 = List.FilterByBoolMask(list=filterByBoolMask_3.in, mask=anyTrue_2)
fillpatterns = Custom[© FillPatterns]()  # package Crumple; Returns all fill patterns in a document.
code_block_36 = CodeBlock { "<Solid fill>"; }
eq_5 = fillpatterns.names == code_block_36
filterByBoolMask_5 = List.FilterByBoolMask(list=fillpatterns.elements, mask=eq_5)
firstItem = List.FirstItem(list=filterByBoolMask_5.in)
color_palette = ColorPalette({R: 46, G: 139, B: 87, A: 255})
create_overridegraphicsettings = Custom[Create OverrideGraphicSettings](SurfaceForegroundPattern=firstItem, SurfaceForegroundPatternColor=color_palette, SurfaceBackgroundPattern=firstItem, SurfaceBackgroundColor=color_palette, CutForegroundPattern=firstItem, CutForegroundPatternColor=color_palette, CutBackgroundPattern=firstItem, CutBackgroundPatternColor=color_palette)  # package Genius Loci; Create a OverrideGraphicSettings (All graphic inputs are optional). Unlike the OOTB OverrideGraphicSettings.ByProperties node, the Foreground and background patterns are available. Note : Prior to Revit 2019, the materials have only one surface pattern and one cut pattern.
view_setelementoverrides = Custom[View SetElementOverrides](view=filterByBoolMask_2.in@L1, elements=filterByBoolMask_4.in@L2, overrides=create_overridegraphicsettings@L1, lacing=Longest)  # package Genius Loci; Overrides element graphics settings in the given view. For use with the Create OverrideGraphicSettings node. Can also be used to hide or unhide elements.
code_block_37 = CodeBlock { 0; }
code_block_38 = CodeBlock(x=code_block_19.out1) { x[1]; }
eq_6 = code_block_37 == code_block_38
byBestFitThroughPoints = Line.ByBestFitThroughPoints()  # unwired: bestFitPoints
byJoinedCurves = PolyCurve.ByJoinedCurves()  # unwired: curves
flatten_2 = List.Flatten(list=intersect)
perimeterCurves = Surface.PerimeterCurves(surface=flatten_2)
flatten_3 = List.Flatten(list=perimeterCurves)
function_apply = ApplyFunction(func=byJoinedCurves, arg1=flatten_3)
code_block_39 = CodeBlock(x=function_apply)  # same code as code_block_22
code_block_40 = CodeBlock { 2000; false; }
offset = PolyCurve.Offset(polyCurve=code_block_39.out1, signedDistance=code_block_40.out0, extendCircular=code_block_40.out1)
byPatch = Surface.ByPatch(closedCurve=offset)
code_block_41 = CodeBlock { [0,1]; [0.5,0.5]; }
pointAtParameter_2 = Surface.PointAtParameter(surface=byPatch, u=code_block_41.out0, v=code_block_41.out1, lacing=Longest)
flatten_4 = List.Flatten(list=pointAtParameter_2)
function_apply_2 = ApplyFunction(func=byBestFitThroughPoints, arg1=flatten_4)
byBestFitThroughPoints_2 = Line.ByBestFitThroughPoints()  # unwired: bestFitPoints
code_block_42 = CodeBlock { [0.5,0.5]; [0,1]; }
pointAtParameter_3 = Surface.PointAtParameter(surface=byPatch, u=code_block_42.out0, v=code_block_42.out1, lacing=Longest)
flatten_5 = List.Flatten(list=pointAtParameter_3)
function_apply_3 = ApplyFunction(func=byBestFitThroughPoints_2, arg1=flatten_5)
scopeIf = Custom[ScopeIf+](test=eq_6, True=function_apply_2, False=function_apply_3)  # package Clockwork for Dynamo 2.x; A (hopefully) more robust implementation of ScopeIf. Tests a single boolean and returns a value accordingly.
code_block_43 = CodeBlock(x=byOriginNormal) { x; }
rotationAngle = Custom[Element.RotationAngle](element=code_block_20)  # package BIM4Struc.Productivity; Get the rotation element of a Revit element. The rotation angle is based on the Location.Rotation property in the RevitAPI. If Location is not equal to a LocationPoint (ie. in case of slanted columns) then the Angle will be set to null.
flatten_6 = List.Flatten(list=rotationAngle)
rotate = Geometry.Rotate(geometry=scopeIf, basePlane=code_block_43, degrees=flatten_6)
code_block_44 = CodeBlock(x=rotate) { x; }
direction = Line.Direction(line=code_block_44)
code_block_45 = CodeBlock(x=direction) { x.X; }
code_block_46 = CodeBlock { 0; }
ge = code_block_45 >= code_block_46
reverse = Curve.Reverse(curve=code_block_44)
scopeIf_2 = Custom[ScopeIf+](test=ge, True=reverse, False=code_block_44, lacing=Shortest)
direction_2 = Line.Direction(line=scopeIf_2)
normalized = Vector.Normalized(vector=direction_2)
code_block_47 = CodeBlock(x=normalized) { x.X; }
code_block_48 = CodeBlock { 0; }
eq_7 = code_block_47 == code_block_48
code_block_49 = CodeBlock(x=normalized) { x.Y; }
code_block_50 = CodeBlock { 0; }
gt = code_block_49 > code_block_50
and_ = eq_7 && gt
reverse_2 = Curve.Reverse(curve=scopeIf_2)
scopeIf_3 = Custom[ScopeIf+](test=and_, True=reverse_2, False=scopeIf_2, lacing=Shortest)
code_block_51 = CodeBlock { "Levels"; }
byName_3 = Category.ByName(name=code_block_51)
all_elements_of_category_2 = ElementsOfCategory(Category=byName_3)
elevation = Level.Elevation(level=all_elements_of_category_2)
minimumItem = List.MinimumItem(list=elevation)
eq_8 = elevation == minimumItem
filterByBoolMask_6 = List.FilterByBoolMask(list=all_elements_of_category_2, mask=eq_8)
plane_2 = Custom[Level.Plane](level=filterByBoolMask_6.in)  # package Clockwork for Dynamo 2.x; Retrieves the plane of a given level
pullOntoPlane = Curve.PullOntoPlane(curve=scopeIf_3, plane=plane_2)
ZAxis = Vector.ZAxis()
code_block_52 = CodeBlock { -3000; }
translate = Geometry.Translate(geometry=pullOntoPlane, direction=ZAxis, distance=code_block_52, lacing=Longest)
code_block_53 = CodeBlock { "Building Section (04_CH)"; }
byName_4 = Orchid.RevitProject.Views.ViewType.ByName(name=code_block_53)
code_block_54 = CodeBlock { 0.5; }
pointAtParameter_4 = Curve.PointAtParameter(curve=translate, param=code_block_54)
code_block_55 = CodeBlock { "Levels"; }
byName_5 = Category.ByName(name=code_block_55)
all_elements_of_category_3 = ElementsOfCategory(Category=byName_5)
elevation_2 = Level.Elevation(level=all_elements_of_category_3)
maximumItem = List.MaximumItem(list=elevation_2)
eq_9 = elevation_2 == maximumItem
filterByBoolMask_7 = List.FilterByBoolMask(list=all_elements_of_category_3, mask=eq_9)
plane_3 = Custom[Level.Plane](level=filterByBoolMask_7.in)
pullOntoPlane_2 = Curve.PullOntoPlane(curve=scopeIf_3, plane=plane_3)
ZAxis_2 = Vector.ZAxis()
code_block_56 = CodeBlock { 3000; }
translate_2 = Geometry.Translate(geometry=pullOntoPlane_2, direction=ZAxis_2, distance=code_block_56, lacing=Longest)
code_block_57 = CodeBlock { 0.5; }
pointAtParameter_5 = Curve.PointAtParameter(curve=translate_2, param=code_block_57)
distanceTo = Geometry.DistanceTo(geometry=pointAtParameter_4, other=pointAtParameter_5)
code_block_58 = CodeBlock { null; }
replaceEmptyLists_2 = Custom[List.ReplaceEmptyLists](seq=distanceTo, Replacement=code_block_58)
code_block_59 = CodeBlock(x=replaceEmptyLists_2)
# ---------- code_block_59.designscript (12 lines) ----------
x;
[Imperative]
{
	if(x == null)
	{
		return = [[]];
	}
	else
	{
		return = x;
	}
};
# ----------------------------------------
code_block_60 = CodeBlock(h=code_block_59.out1)
# ---------- code_block_60.designscript (6 lines) ----------
//height
h[0];
//offset
300;
//depth
300;
# ----------------------------------------
byLine = Custom[ViewSection.ByLine](Curves=translate, ViewFamilyType=byName_4, ViewSectionHeight=code_block_60.out0, OffsetFromLine=code_block_60.out1, Depth=code_block_60.out2)  # package Data-Shapes; Create ViewSections in current document from DS Lines.
code_block_61 = CodeBlock(x=code_block_19.out1) { x[2]; }
setScale = View.SetScale(view=byLine, scale=code_block_61)
code_block_62 = CodeBlock()
# ---------- code_block_62.designscript (4 lines) ----------
[
"View Name",
"Title on Sheet"
];
# ----------------------------------------
code_block_63 = CodeBlock(x=code_block_19.out1) { x[0]; }
code_block_64 = CodeBlock { "Numeracion Columna"; }
getParameterValueByName_5 = Element.GetParameterValueByName(element=code_block_63, parameterName=code_block_64)
code_block_65 = CodeBlock(num=getParameterValueByName_5) { DSCore.List.Flatten(["CH_COLUMNA P"+num,"ELEV. PILAR P"+num],1); }
setParameterByName_3 = Element.SetParameterByName(element=setScale@L1, parameterName=code_block_62@L2, value=code_block_65@L2, lacing=Longest)
flatten_7 = List.Flatten(list=setParameterByName_3)
uniqueItems = List.UniqueItems(list=flatten_7)
all_elements_in_view_s = Custom[All Elements In View(s)](Views=uniqueItems)  # package Data-Shapes; Retrieves all visible element in a view or a set of views
code_block_66 = CodeBlock { "View Name"; }
exists_2 = Orchid.RevitProject.Parameters.Parameter.Exists(parameterName=code_block_66, element=all_elements_in_view_s)
filterByBoolMask_8 = List.FilterByBoolMask(list=all_elements_in_view_s, mask=exists_2)
code_block_67 = CodeBlock { "Type"; }
getParameterValueByName_6 = Element.GetParameterValueByName(element=filterByBoolMask_8.in, parameterName=code_block_67)
name = Orchid.RevitProject.Elements.ElementType.Name(elementType=getParameterValueByName_6)
code_block_68 = CodeBlock { "Building Section (04_CH)"; }
eq_10 = name == code_block_68
filterByBoolMask_9 = List.FilterByBoolMask(list=filterByBoolMask_8.in, mask=eq_10)
hideElements = archilab.Revit.Views.Views.HideElements(view=uniqueItems, elements=filterByBoolMask_9.in)
code_block_69 = CodeBlock { null; }
replaceEmptyLists_3 = Custom[List.ReplaceEmptyLists](seq=hideElements, Replacement=code_block_69)
end = Revit.Transaction.Transaction.End(input=replaceEmptyLists_3)
code_block_70 = CodeBlock(x=end)
# ---------- code_block_70.designscript (13 lines) ----------
x;

[Imperative]
{
	if(x == null)
	{
		return = [];
	}
	else
	{
		return = "Building Section (04_CH)";
	}
};
# ----------------------------------------
byName_6 = Orchid.RevitProject.Views.ViewType.ByName(name=code_block_70.out1)
byType = Orchid.RevitProject.Views.View.ByType(viewType=byName_6)
all_elements_in_view_s_2 = Custom[All Elements In View(s)](Views=byType)
code_block_71 = CodeBlock { "View Name"; }
exists_3 = Orchid.RevitProject.Parameters.Parameter.Exists(parameterName=code_block_71, element=all_elements_in_view_s_2)
filterByBoolMask_10 = List.FilterByBoolMask(list=all_elements_in_view_s_2, mask=exists_3)
code_block_72 = CodeBlock { "Type"; }
getParameterValueByName_7 = Element.GetParameterValueByName(element=filterByBoolMask_10.in, parameterName=code_block_72)
name_2 = Orchid.RevitProject.Elements.ElementType.Name(elementType=getParameterValueByName_7)
code_block_73 = CodeBlock { "Building Section (04_CH)"; }
eq_11 = name_2 == code_block_73
filterByBoolMask_11 = List.FilterByBoolMask(list=filterByBoolMask_10.in, mask=eq_11)
list_clean = Custom[List Clean](list=filterByBoolMask_11.in)  # package Genius Loci; Removes all Null, Empty and Blank from a list or nested list of lists.
hideElements_2 = archilab.Revit.Views.Views.HideElements(view=byType, elements=list_clean)
end_2 = Revit.Transaction.Transaction.End(input=setParameterByName_3)
flatten_8 = List.Flatten(list=end_2)
uniqueItems_2 = List.UniqueItems(list=flatten_8)
code_block_74 = CodeBlock(x=uniqueItems_2) { x; }
code_block_75 = CodeBlock { null; }
replaceEmptyLists_4 = Custom[List.ReplaceEmptyLists](seq=code_block_74, Replacement=code_block_75)
code_block_76 = CodeBlock(x=replaceEmptyLists_4)
# ---------- code_block_76.designscript (13 lines) ----------
x;

[Imperative]
{
	if(x == null)
	{
		return = [[],[]];
	}
	else
	{
		return = x;
	}
};
# ----------------------------------------

# group: Etiqueta Columna Rectangular hormigon
code_block_77 = CodeBlock { "Structural Columns"; }
byName_7 = Category.ByName(name=code_block_77)
code_block_78 = CodeBlock(x=code_block_76.out1) { x; }
code_block_79 = CodeBlock(x=code_block_78) { x[0]; }
all_elements_of_category_in_view = ElementsOfCategoryInView(Category=byName_7, View=code_block_79)
familyName = Orchid.RevitProject.Elements.Element.FamilyName(element=all_elements_of_category_in_view)
code_block_80 = CodeBlock { "EST_M_STRUCTURAL COLUMN_RECTANGULAR"; }
eq_12 = familyName == code_block_80
filterByBoolMask_12 = List.FilterByBoolMask(list=all_elements_of_category_in_view, mask=eq_12)
name_3 = Material.Name()  # unwired: material
getMaterials = Element.GetMaterials(element=filterByBoolMask_12.in)
flatten_9 = List.Flatten(list=getMaterials)
function_apply_4 = ApplyFunction(func=name_3, arg1=flatten_9)
code_block_81 = CodeBlock { "Concrete, Cast-in-Place gray"; }
eq_13 = function_apply_4 == code_block_81
filterByBoolMask_13 = List.FilterByBoolMask(list=filterByBoolMask_12.in, mask=eq_13)
element_taggedstatus = Custom[Element TaggedStatus](element=filterByBoolMask_13.in)  # package Genius Loci; Identify the tagged and untagged elements. Please note : This doesn't work with areas and spaces.
code_block_82 = CodeBlock { "Column Style"; 1; }
setParameterByName_4 = Element.SetParameterByName(element=element_taggedstatus.NotTagged, parameterName=code_block_82.out0, value=code_block_82.out1)
location_2 = Custom[Element.Location+](element=setParameterByName_4)
code_block_83 = CodeBlock(x=location_2.curves)  # same code as code_block_22
await_2 = Orchid.Common.DataStream.Await(pass=setParameterByName_4, waitFor=code_block_83.out1)
code_block_84 = CodeBlock { "Column Style"; 0; }
setParameterByName_5 = Element.SetParameterByName(element=await_2, parameterName=code_block_84.out0, value=code_block_84.out1)
elementcentroid = Custom[© ElementCentroid](element=await_2)  # package Crumple; Returns the centroid of the element's axis-aligned bounding box.
code_block_85 = CodeBlock { 0.5; }
planeAtParameter = Curve.PlaneAtParameter(curve=code_block_83.out1, param=code_block_85)
code_block_86 = CodeBlock { 0.5; }
pointAtParameter_6 = Curve.PointAtParameter(curve=code_block_83.out1, param=code_block_86)
code_block_87 = CodeBlock(x=code_block_78) { x[0]; }
plane_4 = Custom[View.Plane](view=code_block_87)
normal_2 = Plane.Normal(plane=plane_4)
code_block_88 = CodeBlock { 90; }
rotate_2 = Geometry.Rotate(geometry=planeAtParameter, origin=pointAtParameter_6, axis=normal_2, degrees=code_block_88)
normal_3 = Plane.Normal(plane=rotate_2)
code_block_89 = CodeBlock(z=normal_3) { z.Z; }
code_block_90 = CodeBlock { 0; }
gt_2 = code_block_89 > code_block_90
code_block_91 = CodeBlock { -1; }
ne = code_block_89 != code_block_91
and_2 = gt_2 && ne
reverse_3 = Vector.Reverse(vector=normal_3)
scopeIf_4 = Custom[ScopeIf+](test=and_2, True=normal_3, False=reverse_3, lacing=Shortest)
code_block_92 = CodeBlock(x=await_2) { Revit.Elements.Element.GetParameterValueByName(Revit.Elements.Element.GetParameterValueByName(x,"Type"),"Width")/2; }
translate_3 = Geometry.Translate(geometry=elementcentroid, direction=scopeIf_4, distance=code_block_92)
code_block_93 = CodeBlock()
# ---------- code_block_93.designscript (2 lines) ----------
//horizontal
false;
# ----------------------------------------
byElementAndLocation = Tag.ByElementAndLocation(view=code_block_79, element=await_2, location=translate_3, horizontal=code_block_93)
code_block_94 = CodeBlock { "Type"; }
code_block_95 = CodeBlock { "EST_A_STRUCTURAL COLUMN TAG_ELEVACION_DIMENSIONES"; }
byName_8 = Orchid.RevitProject.Elements.Family.ByName(name=code_block_95)
code_block_96 = CodeBlock { "Pilar Hormigon"; }
byFamilyAndName = FamilyType.ByFamilyAndName(family=byName_8, name=code_block_96)
setParameterByName_6 = Element.SetParameterByName(element=byElementAndLocation, parameterName=code_block_94, value=byFamilyAndName)

# group: Etiqueta Columna Circular Hormigon
code_block_97 = CodeBlock { "Structural Columns"; }
byName_9 = Category.ByName(name=code_block_97)
code_block_98 = CodeBlock(x=code_block_76.out1) { x; }
code_block_99 = CodeBlock(x=code_block_98) { x; }
all_elements_of_category_in_view_2 = ElementsOfCategoryInView(Category=byName_9, View=code_block_99)
familyName_2 = Orchid.RevitProject.Elements.Element.FamilyName(element=all_elements_of_category_in_view_2)
code_block_100 = CodeBlock { "EST_M_STRUCTURAL COLUMN_CIRCULAR"; }
eq_14 = familyName_2 == code_block_100
filterByBoolMask_14 = List.FilterByBoolMask(list=all_elements_of_category_in_view_2, mask=eq_14)
name_4 = Material.Name()  # unwired: material
getMaterials_2 = Element.GetMaterials(element=filterByBoolMask_14.in)
flatten_10 = List.Flatten(list=getMaterials_2)
function_apply_5 = ApplyFunction(func=name_4, arg1=flatten_10)
code_block_101 = CodeBlock { "Concrete, Cast-in-Place gray"; }
eq_15 = function_apply_5 == code_block_101
filterByBoolMask_15 = List.FilterByBoolMask(list=filterByBoolMask_14.in, mask=eq_15)
element_taggedstatus_2 = Custom[Element TaggedStatus](element=filterByBoolMask_15.in)
code_block_102 = CodeBlock { "Column Style"; 1; }
setParameterByName_7 = Element.SetParameterByName(element=element_taggedstatus_2.NotTagged, parameterName=code_block_102.out0, value=code_block_102.out1)
location_3 = Custom[Element.Location+](element=setParameterByName_7)
code_block_103 = CodeBlock(x=location_3.curves)  # same code as code_block_22
await_3 = Orchid.Common.DataStream.Await(pass=setParameterByName_7, waitFor=code_block_103.out1)
code_block_104 = CodeBlock { "Column Style"; 0; }
setParameterByName_8 = Element.SetParameterByName(element=await_3, parameterName=code_block_104.out0, value=code_block_104.out1)
elementcentroid_2 = Custom[© ElementCentroid](element=await_3)
code_block_105 = CodeBlock { 0.5; }
planeAtParameter_2 = Curve.PlaneAtParameter(curve=code_block_103.out1, param=code_block_105)
code_block_106 = CodeBlock { 0.5; }
pointAtParameter_7 = Curve.PointAtParameter(curve=code_block_103.out1, param=code_block_106)
code_block_107 = CodeBlock(x=code_block_98) { x; }
plane_5 = Custom[View.Plane](view=code_block_107)
normal_4 = Plane.Normal(plane=plane_5)
code_block_108 = CodeBlock { 90; }
rotate_3 = Geometry.Rotate(geometry=planeAtParameter_2, origin=pointAtParameter_7, axis=normal_4, degrees=code_block_108)
normal_5 = Plane.Normal(plane=rotate_3)
code_block_109 = CodeBlock(z=normal_5) { z.Z; }
code_block_110 = CodeBlock { 0; }
gt_3 = code_block_109 > code_block_110
code_block_111 = CodeBlock { -1; }
ne_2 = code_block_109 != code_block_111
and_3 = gt_3 && ne_2
reverse_4 = Vector.Reverse(vector=normal_5)
scopeIf_5 = Custom[ScopeIf+](test=and_3, True=normal_5, False=reverse_4, lacing=Shortest)
code_block_112 = CodeBlock(x=await_3) { Revit.Elements.Element.GetParameterValueByName(Revit.Elements.Element.GetParameterValueByName(x,"Type"),"Diameter")/2; }
translate_4 = Geometry.Translate(geometry=elementcentroid_2, direction=scopeIf_5, distance=code_block_112)
code_block_113 = CodeBlock()  # same code as code_block_93
byElementAndLocation_2 = Tag.ByElementAndLocation(view=code_block_99, element=await_3, location=translate_4, horizontal=code_block_113)
code_block_114 = CodeBlock { "Type"; }
code_block_115 = CodeBlock { "EST_A_STRUCTURAL COLUMN TAG_ELEVACION_DIMENSIONES"; }
byName_10 = Orchid.RevitProject.Elements.Family.ByName(name=code_block_115)
code_block_116 = CodeBlock { "Pilar Hormigon"; }
byFamilyAndName_2 = FamilyType.ByFamilyAndName(family=byName_10, name=code_block_116)
setParameterByName_9 = Element.SetParameterByName(element=byElementAndLocation_2, parameterName=code_block_114, value=byFamilyAndName_2)

# group: Breaklines
byLoft = Surface.ByLoft()  # unwired: crossSections
translate_5 = Geometry.Translate(lacing=Longest)  # unwired: geometry, direction, distance
byJoinedCurves_2 = PolyCurve.ByJoinedCurves()  # unwired: curves
code_block_117 = CodeBlock { null; }
replaceEmptyLists_5 = Custom[List.ReplaceEmptyLists](seq=code_block_74, Replacement=code_block_117)
code_block_118 = CodeBlock(x=replaceEmptyLists_5)  # same code as code_block_76
code_block_119 = CodeBlock(x=code_block_118.out1) { x[0]; }
getCropBox = Orchid.RevitProject.Views.View.GetCropBox(view=code_block_119)
function_apply_6 = ApplyFunction(func=byJoinedCurves_2, arg1=getCropBox.Curve)
code_block_120 = CodeBlock { -290; false; }
offset_2 = PolyCurve.Offset(polyCurve=function_apply_6, signedDistance=code_block_120.out0, extendCircular=code_block_120.out1)
plane_6 = Custom[View.Plane](view=code_block_119)
normal_6 = Plane.Normal(plane=plane_6)
reverse_5 = Vector.Reverse(vector=normal_6)
list_create_2 = List.Create(item0=normal_6, item1=reverse_5)
code_block_121 = CodeBlock { 1000; }
function_apply_7 = ApplyFunction(func=translate_5, arg1=offset_2, arg2=list_create_2, arg3=code_block_121)
function_apply_8 = ApplyFunction(func=byLoft, arg1=function_apply_7)
byUnion = Solid.ByUnion()  # unwired: solids
code_block_122 = CodeBlock()
# ---------- code_block_122.designscript (6 lines) ----------
[
"Walls",
"Structural Columns",
"Structural Framing",
"Floors"
];
# ----------------------------------------
byName_11 = Category.ByName(name=code_block_122)
all_elements_of_category_in_view_3 = ElementsOfCategoryInView(Category=byName_11, View=code_block_119)
geometry_2 = Element.Geometry(element=all_elements_of_category_in_view_3)
flatten_11 = List.Flatten(list=geometry_2)
function_apply_9 = ApplyFunction(func=byUnion, arg1=flatten_11)
code_block_123 = CodeBlock(x=function_apply_9)
# ---------- code_block_123.designscript (13 lines) ----------
x;

[Imperative]
{
	if(x == null)
	{
		return = [];
	}
	else
	{
		return = x;
	}
};
# ----------------------------------------
intersect_2 = Geometry.Intersect(geometry=function_apply_8, other=code_block_123.out1)
code_block_124 = CodeBlock { [0.5,0.5]; [0,1]; }
pointAtParameter_8 = Surface.PointAtParameter(surface=intersect_2@L1, u=code_block_124.out1@L2, v=code_block_124.out0@L2, lacing=Longest)
transpose = List.Transpose(lists=pointAtParameter_8)
code_block_125 = CodeBlock { null; }
replaceEmptyLists_6 = Custom[List.ReplaceEmptyLists](seq=transpose, Replacement=code_block_125)
code_block_126 = CodeBlock(x=replaceEmptyLists_6)  # same code as code_block_76
code_block_127 = CodeBlock(x=code_block_126.out1) { x[0]; x[1]; }
byStartPointEndPoint = Line.ByStartPointEndPoint(startPoint=code_block_127.out0, endPoint=code_block_127.out1)
reverse_6 = Curve.Reverse(curve=byStartPointEndPoint)
code_block_128 = CodeBlock { "EST_D_BREAKLINE"; }
byName_12 = FamilyType.ByName(name=code_block_128)
code_block_129 = CodeBlock(x=code_block_118.out1) { x[0]; }
byCurve = Custom[DetailComponent.ByCurve](curve=reverse_6, familyType=byName_12, view=code_block_129, lacing=Longest)  # package Clockwork for Dynamo 2.x; Places a line-based detail component in a given view
