# Dynamo graph elevacionVigaEje_script.dyn (Dynamo 2.3.1.11775)
# packages: Clockwork for Dynamo 2.x 2.4.0, Orchid 200.4.0.7938, Data-Shapes 2021.2.94, Crumple 2022.2.13, archi-lab.net 2022.210.2419, Genius Loci 2020.8.3

code_block = CodeBlock { "Elevación Viga en Eje"; }
code_block_2 = CodeBlock()
# ---------- code_block_2.designscript (10 lines) ----------
//buttonText
"INICIAR";
//buttonCancel
"CANCELAR";
//maxHeight

//width
440;
//label
180;
# ----------------------------------------
code_block_3 = CodeBlock { "Seleccionar Vigas:"; }
code_block_4 = CodeBlock { "SELECCIONAR"; }
code_block_5 = CodeBlock { "Structural Framing"; }
byName = Category.ByName(name=code_block_5)
selectmodelelements_data_ordered = Custom[SelectModelElements Data (ordered)](InputName=code_block_3, ButtonText=code_block_4, CategoryFilter=byName)  # package Data-Shapes; Creates a Revit element selection input for UI.MultipleInputForm++ . Check out www.data-shapes.net for more infos!
code_block_6 = CodeBlock { "Seleccionar Eje:"; }
code_block_7 = CodeBlock { "SELECCIONAR"; }
code_block_8 = CodeBlock { "Grids"; }
byName_2 = Category.ByName(name=code_block_8)
code_block_9 = CodeBlock { true; }
selectmodelelements_data = Custom[SelectModelElements Data](InputName=code_block_6, ButtonText=code_block_7, CategoryFilter=byName_2, SelectSingleElement=code_block_9)  # package Data-Shapes; Creates a Revit element selection input for UI.MultipleInputForm++ . Check out www.data-shapes.net for more infos!
code_block_10 = CodeBlock { "Escala:"; }
code_block_11 = CodeBlock()
# ---------- code_block_11.designscript (6 lines) ----------
[
"1:50",
"1:75",
"1:100",
"1:125"
];
# ----------------------------------------
code_block_12 = CodeBlock { ":"; }
split = String.Split(str=code_block_11, separator0=code_block_12)
code_block_13 = CodeBlock { 1; }
getItemAtIndex = List.GetItemAtIndex(list=split@L2, index=code_block_13)
toNumber = String.ToNumber(str=getItemAtIndex)
code_block_14 = CodeBlock { 0; false; }
dropdown_data = Custom[DropDown Data](InputName=code_block_10, Keys=code_block_11, Values=toNumber, DefaultValueIndex=code_block_14.out0, Sorted_optional=code_block_14.out1)  # package Data-Shapes; Create data for DropDown input in UI.MultiInputForm ++ . Check out www.data-shapes.net for more infos.
list_create = List.Create(item0=selectmodelelements_data_ordered, item1=selectmodelelements_data, item2=dropdown_data)
inputgroup_data = Custom[InputGroup Data](Inputs=list_create)  # package Data-Shapes; Creates a group of inputs for UI.MultipleInputForm ++ . Check out www.data-shapes.net for more infos !
boolean = BoolSelector(true)
multipleinputform = Custom[MultipleInputForm ++](Description_optional=code_block, ButtonText_optional=code_block_2.out0, Inputs=inputgroup_data, Toggle=boolean, CancelButtonText_optional=code_block_2.out1, Width_optional=code_block_2.out2, LabelWidth_optional=code_block_2.out3)  # package Data-Shapes; Create a form with multiple inputs. see www.data-shapes.net for tutorials and infos!
code_block_15 = CodeBlock(x=multipleinputform.User_Inputs)
# ---------- code_block_15.designscript (13 lines) ----------
x;

[Imperative]
{
	if(x == null)
	{
		return = [[],[],[]];
	}
	else
	{
		return = x;
	}
};
# ----------------------------------------
code_block_16 = CodeBlock(x=code_block_15.out1) { x[0]; }
color_palette = ColorPalette({R: 0, G: 128, B: 0, A: 255})
overrideColorInView = Element.OverrideColorInView(element=code_block_16, color=color_palette)
byBestFitThroughPoints = Line.ByBestFitThroughPoints()  # unwired: bestFitPoints
code_block_17 = CodeBlock(x=code_block_15.out1) { x[0]; }
location = Custom[Element.Location+](element=code_block_17)  # package Clockwork for Dynamo 2.x; Returns the location of an element as point, curve or curve loop, along with some booleans to help filtering the results. Unlike the OOTB Element.GetLocation node, it also retunrs sketch lines of sketch-based elements like floor slabs as well as the element's rotation property.
code_block_18 = CodeBlock(x=location.curveEndpoints)
# ---------- code_block_18.designscript (13 lines) ----------
x;

[Imperative]
{
	if(x == null)
	{
		return = [[],[]];
	}
	else
	{
		return = x;
	}
};
# ----------------------------------------
flatten = List.Flatten(list=code_block_18.out1)
function_apply = ApplyFunction(func=byBestFitThroughPoints, arg1=flatten)
code_block_19 = CodeBlock(x=function_apply)
# ---------- code_block_19.designscript (13 lines) ----------
x;

[Imperative]
{
	if(x == null)
	{
		return = [];
	}
	else
	{
		return = x;
	}
};
# ----------------------------------------
direction = Line.Direction(line=code_block_19.out1)
code_block_20 = CodeBlock(x=direction) { x.X; }
code_block_21 = CodeBlock { 0; }
ge = code_block_20 >= code_block_21
reverse = Curve.Reverse(curve=code_block_19.out1)
scopeIf = Custom[ScopeIf+](test=ge, True=reverse, False=code_block_19.out1, lacing=Shortest)  # package Clockwork for Dynamo 2.x; A (hopefully) more robust implementation of ScopeIf. Tests a single boolean and returns a value accordingly.
direction_2 = Line.Direction(line=scopeIf)
normalized = Vector.Normalized(vector=direction_2)
code_block_22 = CodeBlock(x=normalized) { x.X; }
code_block_23 = CodeBlock { 0; }
eq = code_block_22 == code_block_23
code_block_24 = CodeBlock(x=normalized) { x.Y; }
code_block_25 = CodeBlock { 0; }
gt = code_block_24 > code_block_25
and_ = eq && gt
reverse_2 = Curve.Reverse(curve=scopeIf)
scopeIf_2 = Custom[ScopeIf+](test=and_, True=reverse_2, False=scopeIf, lacing=Shortest)
code_block_26 = CodeBlock { "Building Section (03_VH)"; }
byName_3 = Orchid.RevitProject.Views.ViewType.ByName(name=code_block_26)
code_block_27 = CodeBlock()
# ---------- code_block_27.designscript (6 lines) ----------
//height
500;
//offset
300;
//depth
300;
# ----------------------------------------
byLine = Custom[ViewSection.ByLine](Curves=scopeIf_2, ViewFamilyType=byName_3, ViewSectionHeight=code_block_27.out0, OffsetFromLine=code_block_27.out1, Depth=code_block_27.out2)  # package Data-Shapes; Create ViewSections in current document from DS Lines.
byJoinedCurves = PolyCurve.ByJoinedCurves()  # unwired: curves
byLoft = Surface.ByLoft()  # unwired: crossSections
ZAxis = Vector.ZAxis()
code_block_28 = CodeBlock { [500,-500]; }
translate = Geometry.Translate(geometry=scopeIf_2, direction=ZAxis, distance=code_block_28)
function_apply_2 = ApplyFunction(func=byLoft, arg1=translate)
code_block_29 = CodeBlock(x=function_apply_2)  # same code as code_block_19
perimeterCurves = Surface.PerimeterCurves(surface=code_block_29.out1)
function_apply_3 = ApplyFunction(func=byJoinedCurves, arg1=perimeterCurves)
code_block_30 = CodeBlock(x=function_apply_3)  # same code as code_block_19
code_block_31 = CodeBlock { 1000; false; }
offset = PolyCurve.Offset(polyCurve=code_block_30.out1, signedDistance=code_block_31.out0, extendCircular=code_block_31.out1)
explode = Geometry.Explode(geometry=offset)
setCropBox = Orchid.RevitProject.Views.View.SetCropBox(view=byLine, curve=explode)
code_block_32 = CodeBlock(x=code_block_15.out1) { x[2]; }
setScale = View.SetScale(view=setCropBox, scale=code_block_32)
code_block_33 = CodeBlock { ["View Name","Title on Sheet"]; }
activeView = Orchid.RevitProject.Common.Document.ActiveView()
viewlevel = Custom[© ViewLevel](views=activeView)  # package Crumple; Returns the associated level of a view (if it has one), as well as a boolean mask to remove views without levels after.
name = Level.Name(level=viewlevel.lvls)
code_block_34 = CodeBlock(x=code_block_15.out1) { x[1]; }
name_2 = Element.Name(element=code_block_34)
code_block_35 = CodeBlock(lvl=name, gr=name_2)
# ---------- code_block_35.designscript (2 lines) ----------
["VH_CIELO "+lvl+"_EJE "+gr,
"ELEV. VIGA CIELO "+lvl+",EJE "+gr];
# ----------------------------------------
setParameterByName = Element.SetParameterByName(element=setScale, parameterName=code_block_33, value=code_block_35, lacing=Longest)
flatten_2 = List.Flatten(list=setParameterByName)
uniqueItems = List.UniqueItems(list=flatten_2)
all_elements_in_view_s = Custom[All Elements In View(s)](Views=uniqueItems)  # package Data-Shapes; Retrieves all visible element in a view or a set of views
code_block_36 = CodeBlock { "View Name"; }
exists = Orchid.RevitProject.Parameters.Parameter.Exists(parameterName=code_block_36, element=all_elements_in_view_s)
filterByBoolMask = List.FilterByBoolMask(list=all_elements_in_view_s, mask=exists)
code_block_37 = CodeBlock { "Type"; }
getParameterValueByName = Element.GetParameterValueByName(element=filterByBoolMask.in, parameterName=code_block_37)
name_3 = Orchid.RevitProject.Elements.ElementType.Name(elementType=getParameterValueByName)
code_block_38 = CodeBlock { "Building Section (03_VH)"; }
eq_2 = name_3 == code_block_38
filterByBoolMask_2 = List.FilterByBoolMask(list=filterByBoolMask.in, mask=eq_2)
hideElements = archilab.Revit.Views.Views.HideElements(view=uniqueItems, elements=filterByBoolMask_2.in)
code_block_39 = CodeBlock { null; }
replaceEmptyLists = Custom[List.ReplaceEmptyLists](seq=hideElements, Replacement=code_block_39)  # package Clockwork for Dynamo 2.x; Replaces all empty lists within a given list with a substitute
end = Revit.Transaction.Transaction.End(input=replaceEmptyLists)
code_block_40 = CodeBlock(x=end)
# ---------- code_block_40.designscript (13 lines) ----------
x;

[Imperative]
{
	if(x == null)
	{
		return = [];
	}
	else
	{
		return = "Building Section (02_MA)";
	}
};
# ----------------------------------------
byName_4 = Orchid.RevitProject.Views.ViewType.ByName(name=code_block_40.out1)
byType = Orchid.RevitProject.Views.View.ByType(viewType=byName_4)
all_elements_in_view_s_2 = Custom[All Elements In View(s)](Views=byType)
code_block_41 = CodeBlock { "View Name"; }
exists_2 = Orchid.RevitProject.Parameters.Parameter.Exists(parameterName=code_block_41, element=all_elements_in_view_s_2)
filterByBoolMask_3 = List.FilterByBoolMask(list=all_elements_in_view_s_2, mask=exists_2)
code_block_42 = CodeBlock { "Type"; }
getParameterValueByName_2 = Element.GetParameterValueByName(element=filterByBoolMask_3.in, parameterName=code_block_42)
name_4 = Orchid.RevitProject.Elements.ElementType.Name(elementType=getParameterValueByName_2)
code_block_43 = CodeBlock { "Building Section (03_VH)"; }
eq_3 = name_4 == code_block_43
filterByBoolMask_4 = List.FilterByBoolMask(list=filterByBoolMask_3.in, mask=eq_3)
list_clean = Custom[List Clean](list=filterByBoolMask_4.in)  # package Genius Loci; Removes all Null, Empty and Blank from a list or nested list of lists.
hideElements_2 = archilab.Revit.Views.Views.HideElements(view=byType, elements=list_clean)
