# Dynamo graph etiquetadoElevMA_script.dyn (Dynamo 2.3.1.11775)
# packages: Orchid 200.4.0.7938, Clockwork for Dynamo 2.x 2.4.0, archi-lab.net 2022.210.2419, Genius Loci 2020.8.3, Crumple 2022.2.13

activeView = Orchid.RevitProject.Common.Document.ActiveView()

# group: Etiqueta Muros
activeView_2 = Orchid.RevitProject.Common.Document.ActiveView()
code_block = CodeBlock { "Walls"; }
byName = Category.ByName(name=code_block)
code_block_2 = CodeBlock(x=activeView) { x; }
all_elements_of_category_in_view = ElementsOfCategoryInView(Category=byName, View=code_block_2)
wallType = archilab.Revit.Elements.Walls.WallType(wall=all_elements_of_category_in_view)
kind = Orchid.RevitProject.Elements.WallType.Kind(wallType=wallType)
code_block_3 = CodeBlock { "Basic"; }
eq = kind == code_block_3
filterByBoolMask = List.FilterByBoolMask(list=all_elements_of_category_in_view, mask=eq)
name = Material.Name()  # unwired: material
getMaterials = Element.GetMaterials(element=filterByBoolMask.in)
flatten = List.Flatten(list=getMaterials)
function_apply = ApplyFunction(func=name, arg1=flatten)
code_block_4 = CodeBlock { "Concrete, Cast-in-Place gray"; }
eq_2 = function_apply == code_block_4
filterByBoolMask_2 = List.FilterByBoolMask(list=filterByBoolMask.in, mask=eq_2)
location = Custom[Element.Location+](element=filterByBoolMask_2.in)  # package Clockwork for Dynamo 2.x; Returns the location of an element as point, curve or curve loop, along with some booleans to help filtering the results. Unlike the OOTB Element.GetLocation node, it also retunrs sketch lines of sketch-based elements like floor slabs as well as the element's rotation property.
code_block_5 = CodeBlock(x=location.curves)
# ---------- code_block_5.designscript (12 lines) ----------
x;
[Imperative]
{
	if(x == null)
	{
		return = [];
	}
	else
	{
		return = x;
	}
};
# ----------------------------------------
direction = Line.Direction(line=code_block_5.out1)
activeView_3 = Orchid.RevitProject.Common.Document.ActiveView()
plane = Custom[View.Plane](view=activeView_3)  # package Clockwork for Dynamo 2.x; Retrieves the plane of a given view
isParallelToPlane = Custom[Vector.IsParallelToPlane](vector=direction, plane=plane)  # package Clockwork for Dynamo 2.x; Checks if a given vector is parallel to a given plane
filterByBoolMask_3 = List.FilterByBoolMask(list=filterByBoolMask_2.in, mask=isParallelToPlane)
element_taggedstatus = Custom[Element TaggedStatus](element=filterByBoolMask_3.in)  # package Genius Loci; Identify the tagged and untagged elements. Please note : This doesn't work with areas and spaces.
elementcentroid = Custom[© ElementCentroid](element=element_taggedstatus.NotTagged)  # package Crumple; Returns the centroid of the element's axis-aligned bounding box.
byElementAndLocation = Tag.ByElementAndLocation(view=activeView_2, element=element_taggedstatus.NotTagged, location=elementcentroid)
code_block_6 = CodeBlock { "Type"; }
code_block_7 = CodeBlock { "EST_A_WALL TAG_ELEVACION_MHA"; }
byName_2 = Orchid.RevitProject.Elements.Family.ByName(name=code_block_7)
code_block_8 = CodeBlock { "Doble Malla"; }
byFamilyAndName = FamilyType.ByFamilyAndName(family=byName_2, name=code_block_8)
setParameterByName = Element.SetParameterByName(element=byElementAndLocation, parameterName=code_block_6, value=byFamilyAndName)

# group: Etiqueta Vigas Rectangulares
activeView_4 = Orchid.RevitProject.Common.Document.ActiveView()
code_block_9 = CodeBlock { "Structural Framing"; }
byName_3 = Category.ByName(name=code_block_9)
code_block_10 = CodeBlock(x=activeView) { x; }
all_elements_of_category_in_view_2 = ElementsOfCategoryInView(Category=byName_3, View=code_block_10)
familyName = Orchid.RevitProject.Elements.Element.FamilyName(element=all_elements_of_category_in_view_2)
code_block_11 = CodeBlock()
# ---------- code_block_11.designscript (16 lines) ----------
[
"EST_M_STRUCTURAL FRAMING_VIGA INVERTIDA",
"EST_M_STRUCTURAL FRAMING_VIGA SEMI INVERTIDA",
"EST_M_STRUCTURAL FRAMING_VIGA TRADICIONAL",
"EST_M_STRUCTURAL FRAMING_VIGA FUNDACION",
"EST_M_STRUCTURAL FRAMING_VIGA LAMINADA_L",
"EST_M_STRUCTURAL FRAMING_VIGA OHM",
"EST_M_STRUCTURAL FRAMING_VIGA PLEGADA_C",
"EST_M_STRUCTURAL FRAMING_VIGA PLEGADA_CA",
"EST_M_STRUCTURAL FRAMING_VIGA PLEGADA_HSS",
"EST_M_STRUCTURAL FRAMING_VIGA PLEGADA_HSSE",
"EST_M_STRUCTURAL FRAMING_VIGA PLEGADA_L",
"EST_M_STRUCTURAL FRAMING_VIGA SOLDADA_HN",
"EST_M_STRUCTURAL FRAMING_VIGA SOLDADA_IN",
"EST_M_STRUCTURAL FRAMING_VIGA SOLDADA_T"
];
# ----------------------------------------
eq_3 = familyName@L1 == code_block_11
anyTrue = Orchid.Common.List.AnyTrue(list=eq_3)
filterByBoolMask_4 = List.FilterByBoolMask(list=all_elements_of_category_in_view_2, mask=anyTrue)
location_2 = Custom[Element.Location+](element=filterByBoolMask_4.in)
code_block_12 = CodeBlock(x=location_2.curves)  # same code as code_block_5
direction_2 = Line.Direction(line=code_block_12.out1)
activeView_5 = Orchid.RevitProject.Common.Document.ActiveView()
plane_2 = Custom[View.Plane](view=activeView_5)
isParallelToPlane_2 = Custom[Vector.IsParallelToPlane](vector=direction_2, plane=plane_2)
filterByBoolMask_5 = List.FilterByBoolMask(list=filterByBoolMask_4.in, mask=isParallelToPlane_2)
element_taggedstatus_2 = Custom[Element TaggedStatus](element=filterByBoolMask_5.in)
elementcentroid_2 = Custom[© ElementCentroid](element=element_taggedstatus_2.NotTagged)
location_3 = Custom[Element.Location+](element=element_taggedstatus_2.NotTagged)
code_block_13 = CodeBlock(x=location_3.curves)  # same code as code_block_5
code_block_14 = CodeBlock { 0.5; }
planeAtParameter = Curve.PlaneAtParameter(curve=code_block_13.out1, param=code_block_14)
code_block_15 = CodeBlock { 0.5; }
pointAtParameter = Curve.PointAtParameter(curve=code_block_13.out1, param=code_block_15)
activeView_6 = Orchid.RevitProject.Common.Document.ActiveView()
plane_3 = Custom[View.Plane](view=activeView_6)
normal = Plane.Normal(plane=plane_3)
code_block_16 = CodeBlock { 90; }
rotate = Geometry.Rotate(geometry=planeAtParameter, origin=pointAtParameter, axis=normal, degrees=code_block_16)
normal_2 = Plane.Normal(plane=rotate)
code_block_17 = CodeBlock(z=normal_2) { z.Z; }
code_block_18 = CodeBlock { 0; }
gt = code_block_17 > code_block_18
code_block_19 = CodeBlock { -1; }
ne = code_block_17 != code_block_19
and_ = gt && ne
reverse = Vector.Reverse(vector=normal_2)
scopeIf = Custom[ScopeIf+](test=and_, True=normal_2, False=reverse, lacing=Shortest)  # package Clockwork for Dynamo 2.x; A (hopefully) more robust implementation of ScopeIf. Tests a single boolean and returns a value accordingly.
code_block_20 = CodeBlock(x=element_taggedstatus_2.NotTagged) { Revit.Elements.Element.GetParameterValueByName(Revit.Elements.Element.GetParameterValueByName(x,"Type"),"Height")/2; }
translate = Geometry.Translate(geometry=elementcentroid_2, direction=scopeIf, distance=code_block_20)
list_create = List.Create(item0=elementcentroid_2, item1=translate)
transpose = List.Transpose(lists=list_create)
byElementAndLocation_2 = Tag.ByElementAndLocation(view=activeView_4@L1, element=element_taggedstatus_2.NotTagged@L1, location=transpose@L2, lacing=Longest)
transpose_2 = List.Transpose(lists=byElementAndLocation_2)
code_block_21 = CodeBlock { null; }
replaceEmptyLists = Custom[List.ReplaceEmptyLists](seq=transpose_2, Replacement=code_block_21)  # package Clockwork for Dynamo 2.x; Replaces all empty lists within a given list with a substitute
code_block_22 = CodeBlock(x=replaceEmptyLists)
# ---------- code_block_22.designscript (12 lines) ----------
x;
[Imperative]
{
	if(x == null)
	{
		return = [[],[]];
	}
	else
	{
		return = x;
	}
};
# ----------------------------------------
code_block_23 = CodeBlock(x=code_block_22.out1) { x[1]; }
code_block_24 = CodeBlock { "Type"; }
code_block_25 = CodeBlock { "EST_A_STRUCTURAL FRAMING TAG_ELEVACION"; }
byName_4 = Orchid.RevitProject.Elements.Family.ByName(name=code_block_25)
code_block_26 = CodeBlock { "Tag Viga"; }
byFamilyAndName_2 = FamilyType.ByFamilyAndName(family=byName_4, name=code_block_26)
setParameterByName_2 = Element.SetParameterByName(element=code_block_23, parameterName=code_block_24, value=byFamilyAndName_2)
name_2 = Material.Name()  # unwired: material
getMaterials_2 = Element.GetMaterials(element=filterByBoolMask_4.in)
flatten_2 = List.Flatten(list=getMaterials_2)
function_apply_2 = ApplyFunction(func=name_2, arg1=flatten_2)
code_block_27 = CodeBlock { "Concrete, Cast-in-Place gray"; }
eq_4 = function_apply_2 == code_block_27
filterByBoolMask_6 = List.FilterByBoolMask(list=filterByBoolMask_4.in, mask=eq_4)
code_block_28 = CodeBlock(x=code_block_22.out1) { x[0]; }
code_block_29 = CodeBlock { "Type"; }
code_block_30 = CodeBlock { "EST_A_STRUCTURAL FRAMING TAG_ELEVACION_ESTRIBO Y LATERAL"; }
byName_5 = Orchid.RevitProject.Elements.Family.ByName(name=code_block_30)
code_block_31 = CodeBlock { "Estribo Simple y Laterales"; }
byFamilyAndName_3 = FamilyType.ByFamilyAndName(family=byName_5, name=code_block_31)
setParameterByName_3 = Element.SetParameterByName(element=code_block_28, parameterName=code_block_29, value=byFamilyAndName_3)

# group: Etiqueta Columna Rectangular hormigon
code_block_32 = CodeBlock { "Structural Columns"; }
byName_6 = Category.ByName(name=code_block_32)
code_block_33 = CodeBlock(x=activeView) { x; }
all_elements_of_category_in_view_3 = ElementsOfCategoryInView(Category=byName_6, View=code_block_33)
familyName_2 = Orchid.RevitProject.Elements.Element.FamilyName(element=all_elements_of_category_in_view_3)
code_block_34 = CodeBlock { "EST_M_STRUCTURAL COLUMN_RECTANGULAR"; }
eq_5 = familyName_2 == code_block_34
filterByBoolMask_7 = List.FilterByBoolMask(list=all_elements_of_category_in_view_3, mask=eq_5)
name_3 = Material.Name()  # unwired: material
getMaterials_3 = Element.GetMaterials(element=filterByBoolMask_7.in)
flatten_3 = List.Flatten(list=getMaterials_3)
function_apply_3 = ApplyFunction(func=name_3, arg1=flatten_3)
code_block_35 = CodeBlock { "Concrete, Cast-in-Place gray"; }
eq_6 = function_apply_3 == code_block_35
filterByBoolMask_8 = List.FilterByBoolMask(list=filterByBoolMask_7.in, mask=eq_6)
element_taggedstatus_3 = Custom[Element TaggedStatus](element=filterByBoolMask_8.in)
code_block_36 = CodeBlock { "Column Style"; 1; }
setParameterByName_4 = Element.SetParameterByName(element=element_taggedstatus_3.NotTagged, parameterName=code_block_36.out0, value=code_block_36.out1)
location_4 = Custom[Element.Location+](element=setParameterByName_4)
code_block_37 = CodeBlock(x=location_4.curves)  # same code as code_block_5
await_ = Orchid.Common.DataStream.Await(pass=setParameterByName_4, waitFor=code_block_37.out1)
code_block_38 = CodeBlock { "Column Style"; 0; }
setParameterByName_5 = Element.SetParameterByName(element=await_, parameterName=code_block_38.out0, value=code_block_38.out1)
activeView_7 = Orchid.RevitProject.Common.Document.ActiveView()
elementcentroid_3 = Custom[© ElementCentroid](element=await_)
code_block_39 = CodeBlock { 0.5; }
planeAtParameter_2 = Curve.PlaneAtParameter(curve=code_block_37.out1, param=code_block_39)
code_block_40 = CodeBlock { 0.5; }
pointAtParameter_2 = Curve.PointAtParameter(curve=code_block_37.out1, param=code_block_40)
activeView_8 = Orchid.RevitProject.Common.Document.ActiveView()
plane_4 = Custom[View.Plane](view=activeView_8)
normal_3 = Plane.Normal(plane=plane_4)
code_block_41 = CodeBlock { 90; }
rotate_2 = Geometry.Rotate(geometry=planeAtParameter_2, origin=pointAtParameter_2, axis=normal_3, degrees=code_block_41)
normal_4 = Plane.Normal(plane=rotate_2)
code_block_42 = CodeBlock(z=normal_4) { z.Z; }
code_block_43 = CodeBlock { 0; }
gt_2 = code_block_42 > code_block_43
code_block_44 = CodeBlock { -1; }
ne_2 = code_block_42 != code_block_44
and_2 = gt_2 && ne_2
reverse_2 = Vector.Reverse(vector=normal_4)
scopeIf_2 = Custom[ScopeIf+](test=and_2, True=normal_4, False=reverse_2, lacing=Shortest)
code_block_45 = CodeBlock(x=await_) { Revit.Elements.Element.GetParameterValueByName(Revit.Elements.Element.GetParameterValueByName(x,"Type"),"Width")/2; }
translate_2 = Geometry.Translate(geometry=elementcentroid_3, direction=scopeIf_2, distance=code_block_45)
code_block_46 = CodeBlock()
# ---------- code_block_46.designscript (2 lines) ----------
//horizontal
false;
# ----------------------------------------
byElementAndLocation_3 = Tag.ByElementAndLocation(view=activeView_7, element=await_, location=translate_2, horizontal=code_block_46)
code_block_47 = CodeBlock { "Type"; }
code_block_48 = CodeBlock { "EST_A_STRUCTURAL COLUMN TAG_ELEVACION_DIMENSIONES"; }
byName_7 = Orchid.RevitProject.Elements.Family.ByName(name=code_block_48)
code_block_49 = CodeBlock { "Pilar Hormigon"; }
byFamilyAndName_4 = FamilyType.ByFamilyAndName(family=byName_7, name=code_block_49)
setParameterByName_6 = Element.SetParameterByName(element=byElementAndLocation_3, parameterName=code_block_47, value=byFamilyAndName_4)

# group: Etiqueta Columna Circular Hormigon
code_block_50 = CodeBlock { "Structural Columns"; }
byName_8 = Category.ByName(name=code_block_50)
code_block_51 = CodeBlock(x=activeView) { x; }
all_elements_of_category_in_view_4 = ElementsOfCategoryInView(Category=byName_8, View=code_block_51)
familyName_3 = Orchid.RevitProject.Elements.Element.FamilyName(element=all_elements_of_category_in_view_4)
code_block_52 = CodeBlock { "EST_M_STRUCTURAL COLUMN_CIRCULAR"; }
eq_7 = familyName_3 == code_block_52
filterByBoolMask_9 = List.FilterByBoolMask(list=all_elements_of_category_in_view_4, mask=eq_7)
name_4 = Material.Name()  # unwired: material
getMaterials_4 = Element.GetMaterials(element=filterByBoolMask_9.in)
flatten_4 = List.Flatten(list=getMaterials_4)
function_apply_4 = ApplyFunction(func=name_4, arg1=flatten_4)
code_block_53 = CodeBlock { "Concrete, Cast-in-Place gray"; }
eq_8 = function_apply_4 == code_block_53
filterByBoolMask_10 = List.FilterByBoolMask(list=filterByBoolMask_9.in, mask=eq_8)
element_taggedstatus_4 = Custom[Element TaggedStatus](element=filterByBoolMask_10.in)
code_block_54 = CodeBlock { "Column Style"; 1; }
setParameterByName_7 = Element.SetParameterByName(element=element_taggedstatus_4.NotTagged, parameterName=code_block_54.out0, value=code_block_54.out1)
location_5 = Custom[Element.Location+](element=setParameterByName_7)
code_block_55 = CodeBlock(x=location_5.curves)  # same code as code_block_5
await_2 = Orchid.Common.DataStream.Await(pass=setParameterByName_7, waitFor=code_block_55.out1)
code_block_56 = CodeBlock { "Column Style"; 0; }
setParameterByName_8 = Element.SetParameterByName(element=await_2, parameterName=code_block_56.out0, value=code_block_56.out1)
activeView_9 = Orchid.RevitProject.Common.Document.ActiveView()
elementcentroid_4 = Custom[© ElementCentroid](element=await_2)
code_block_57 = CodeBlock { 0.5; }
planeAtParameter_3 = Curve.PlaneAtParameter(curve=code_block_55.out1, param=code_block_57)
code_block_58 = CodeBlock { 0.5; }
pointAtParameter_3 = Curve.PointAtParameter(curve=code_block_55.out1, param=code_block_58)
activeView_10 = Orchid.RevitProject.Common.Document.ActiveView()
plane_5 = Custom[View.Plane](view=activeView_10)
normal_5 = Plane.Normal(plane=plane_5)
code_block_59 = CodeBlock { 90; }
rotate_3 = Geometry.Rotate(geometry=planeAtParameter_3, origin=pointAtParameter_3, axis=normal_5, degrees=code_block_59)
normal_6 = Plane.Normal(plane=rotate_3)
code_block_60 = CodeBlock(z=normal_6) { z.Z; }
code_block_61 = CodeBlock { 0; }
gt_3 = code_block_60 > code_block_61
code_block_62 = CodeBlock { -1; }
ne_3 = code_block_60 != code_block_62
and_3 = gt_3 && ne_3
reverse_3 = Vector.Reverse(vector=normal_6)
scopeIf_3 = Custom[ScopeIf+](test=and_3, True=normal_6, False=reverse_3, lacing=Shortest)
code_block_63 = CodeBlock(x=await_2) { Revit.Elements.Element.GetParameterValueByName(Revit.Elements.Element.GetParameterValueByName(x,"Type"),"Diameter")/2; }
translate_3 = Geometry.Translate(geometry=elementcentroid_4, direction=scopeIf_3, distance=code_block_63)
code_block_64 = CodeBlock()  # same code as code_block_46
byElementAndLocation_4 = Tag.ByElementAndLocation(view=activeView_9, element=await_2, location=translate_3, horizontal=code_block_64)
code_block_65 = CodeBlock { "Type"; }
code_block_66 = CodeBlock { "EST_A_STRUCTURAL COLUMN TAG_ELEVACION_DIMENSIONES"; }
byName_9 = Orchid.RevitProject.Elements.Family.ByName(name=code_block_66)
code_block_67 = CodeBlock { "Pilar Hormigon"; }
byFamilyAndName_5 = FamilyType.ByFamilyAndName(family=byName_9, name=code_block_67)
setParameterByName_9 = Element.SetParameterByName(element=byElementAndLocation_4, parameterName=code_block_65, value=byFamilyAndName_5)

# group: Columnas Metalicas Rectangulares
activeView_11 = Orchid.RevitProject.Common.Document.ActiveView()
code_block_68 = CodeBlock { "Structural Columns"; }
byName_10 = Category.ByName(name=code_block_68)
code_block_69 = CodeBlock(x=activeView) { x; }
all_elements_of_category_in_view_5 = ElementsOfCategoryInView(Category=byName_10, View=code_block_69)
familyName_4 = Orchid.RevitProject.Elements.Element.FamilyName(element=all_elements_of_category_in_view_5)
code_block_70 = CodeBlock()
# ---------- code_block_70.designscript (11 lines) ----------
[
"EST_M_STRUCTURAL COLUMN_SOLDADA_IN",
"EST_M_STRUCTURAL COLUMN_LAMINADA_L",
"EST_M_STRUCTURAL COLUMN_PLEGADA_C",
"EST_M_STRUCTURAL COLUMN_PLEGADA_CA",
"EST_M_STRUCTURAL COLUMN_PLEGADA_HSS",
"EST_M_STRUCTURAL COLUMN_PLEGADA_IC",
"EST_M_STRUCTURAL COLUMN_PLEGADA_L",
"EST_M_STRUCTURAL COLUMN_SOLDADA_HN",
"EST_M_STRUCTURAL COLUMN_SOLDADA_T"
];
# ----------------------------------------
eq_9 = familyName_4@L1 == code_block_70
anyTrue_2 = Orchid.Common.List.AnyTrue(list=eq_9)
filterByBoolMask_11 = List.FilterByBoolMask(list=all_elements_of_category_in_view_5, mask=anyTrue_2)
name_5 = Material.Name()  # unwired: material
getMaterials_5 = Element.GetMaterials(element=filterByBoolMask_11.in)
flatten_5 = List.Flatten(list=getMaterials_5)
function_apply_5 = ApplyFunction(func=name_5, arg1=flatten_5)
code_block_71 = CodeBlock { "Steel"; }
eq_10 = function_apply_5 == code_block_71
filterByBoolMask_12 = List.FilterByBoolMask(list=filterByBoolMask_11.in, mask=eq_10)
element_taggedstatus_5 = Custom[Element TaggedStatus](element=filterByBoolMask_12.in)
code_block_72 = CodeBlock { "Column Style"; 1; }
setParameterByName_10 = Element.SetParameterByName(element=element_taggedstatus_5.NotTagged, parameterName=code_block_72.out0, value=code_block_72.out1)
location_6 = Custom[Element.Location+](element=setParameterByName_10)
code_block_73 = CodeBlock(x=location_6.curves)  # same code as code_block_5
await_3 = Orchid.Common.DataStream.Await(pass=setParameterByName_10, waitFor=code_block_73.out1)
elementcentroid_5 = Custom[© ElementCentroid](element=await_3)
code_block_74 = CodeBlock { 0.5; }
planeAtParameter_4 = Curve.PlaneAtParameter(curve=code_block_73.out1, param=code_block_74)
code_block_75 = CodeBlock { 0.5; }
pointAtParameter_4 = Curve.PointAtParameter(curve=code_block_73.out1, param=code_block_75)
activeView_12 = Orchid.RevitProject.Common.Document.ActiveView()
plane_6 = Custom[View.Plane](view=activeView_12)
normal_7 = Plane.Normal(plane=plane_6)
code_block_76 = CodeBlock { 90; }
rotate_4 = Geometry.Rotate(geometry=planeAtParameter_4, origin=pointAtParameter_4, axis=normal_7, degrees=code_block_76)
normal_8 = Plane.Normal(plane=rotate_4)
code_block_77 = CodeBlock(z=normal_8) { z.Z; }
code_block_78 = CodeBlock { 0; }
gt_4 = code_block_77 > code_block_78
code_block_79 = CodeBlock { -1; }
ne_4 = code_block_77 != code_block_79
and_4 = gt_4 && ne_4
reverse_4 = Vector.Reverse(vector=normal_8)
scopeIf_4 = Custom[ScopeIf+](test=and_4, True=normal_8, False=reverse_4, lacing=Shortest)
code_block_80 = CodeBlock(x=await_3) { Revit.Elements.Element.GetParameterValueByName(Revit.Elements.Element.GetParameterValueByName(x,"Type"),"Width")/2; }
translate_4 = Geometry.Translate(geometry=elementcentroid_5, direction=scopeIf_4, distance=code_block_80)
code_block_81 = CodeBlock()  # same code as code_block_46
byElementAndLocation_5 = Tag.ByElementAndLocation(view=activeView_11, element=await_3, location=translate_4, horizontal=code_block_81)
code_block_82 = CodeBlock { "Type"; }
code_block_83 = CodeBlock { "EST_A_STRUCTURAL COLUMN TAG_ELEVACION_DIMENSIONES"; }
byName_11 = Orchid.RevitProject.Elements.Family.ByName(name=code_block_83)
code_block_84 = CodeBlock { "Pilar Hormigon"; }
byFamilyAndName_6 = FamilyType.ByFamilyAndName(family=byName_11, name=code_block_84)
setParameterByName_11 = Element.SetParameterByName(element=byElementAndLocation_5, parameterName=code_block_82, value=byFamilyAndName_6)
code_block_85 = CodeBlock { "Column Style"; 0; }
setParameterByName_12 = Element.SetParameterByName(element=await_3, parameterName=code_block_85.out0, value=code_block_85.out1)
