# Dynamo graph plantaFundacion_script.dyn (Dynamo 2.3.1.11775)
# packages: Orchid 200.4.0.7938, Crumple 2022.2.13, Genius Loci 2020.8.3

activeView = Orchid.RevitProject.Common.Document.ActiveView()
code_block = CodeBlock { "Structural Framing"; }
byName = Category.ByName(name=code_block)
activeView_2 = Orchid.RevitProject.Common.Document.ActiveView()
code_block_2 = CodeBlock(x=activeView_2) { x; }
all_elements_of_category_in_view = ElementsOfCategoryInView(Category=byName, View=code_block_2)
getMaterials = Element.GetMaterials(element=all_elements_of_category_in_view)
code_block_3 = CodeBlock { 0; }
getItemAtIndex = List.GetItemAtIndex(list=getMaterials@L2, index=code_block_3)
name = Material.Name(material=getItemAtIndex)
code_block_4 = CodeBlock { "Concrete, Cast-in-Place gray"; }
eq = name == code_block_4
filterByBoolMask = List.FilterByBoolMask(list=all_elements_of_category_in_view, mask=eq)
element_taggedstatus = Custom[Element TaggedStatus](element=filterByBoolMask.in)  # package Genius Loci; Identify the tagged and untagged elements. Please note : This doesn't work with areas and spaces.
code_block_5 = CodeBlock { "EST_A_STRUCTURAL FRAMING TAG_PLANTA"; }
byName_2 = Orchid.RevitProject.Elements.Family.ByName(name=code_block_5)
code_block_6 = CodeBlock { "Tag Viga"; }
byFamilyAndName = FamilyType.ByFamilyAndName(family=byName_2, name=code_block_6)
elementcentroid = Custom[© ElementCentroid](element=element_taggedstatus.NotTagged)  # package Crumple; Returns the centroid of the element's axis-aligned bounding box.
byElementAndLocation = Orchid.RevitProject.Annotations.Tag.ByElementAndLocation(view=activeView, element=element_taggedstatus.NotTagged, tagType=byFamilyAndName, location=elementcentroid)  # frozen
familyName = Orchid.RevitProject.Elements.Element.FamilyName(element=all_elements_of_category_in_view)
